# Dynamo graph apply_collision_to_mesh.dyn (Dynamo 2.0.2.6826)

# group: Depricated
string = StringInput("C:\_DegreeProject-Spring19-AndreWisen\190130 - Revit Collision\ids.csv")
categories = Categories(index=599)
all_elements_of_category = ElementsOfCategory(Category=categories)
name = Element.Name(element=all_elements_of_category)
exportCSV = Data.ExportCSV(filePath=string, data=name)

# group: Select Categories
categories_2 = Categories()  # nothing selected
categories_3 = Categories(index=599)
categories_4 = Categories(index=408)
categories_5 = Categories(index=208)

all_elements_of_category_2 = ElementsOfCategory(Category=categories_2)
name_2 = Element.Name(element=all_elements_of_category_2)
string_2 = StringInput("C:\_DegreeProject-Spring19-AndreWisen\190130 - Revit Collision\ids2.csv")
all_elements_of_category_3 = ElementsOfCategory(Category=categories_3)
name_3 = Element.Name(element=all_elements_of_category_3)
all_elements_of_category_4 = ElementsOfCategory(Category=categories_4)
name_4 = Element.Name(element=all_elements_of_category_4)
all_elements_of_category_5 = ElementsOfCategory(Category=categories_5)
name_5 = Element.Name(element=all_elements_of_category_5)
join = List.Join(list0=name_3, list1=name_4, list2=name_5)
exportCSV_2 = Data.ExportCSV(filePath=string_2, data=join)
