# Dynamo graph ReadJSON.dyn (Dynamo 2.0.2.6826)

# group: Filepath
# note: N.B. Be sure to add a backslash at the end of the string.
# E.g. "C:\Users\localusers\Revit\"
directory = StringInput("C:\GitHub\AI281X-DegreeProject\v2\CSV-Files\")
# note: E.g. "myJSON.txt"
filename_inc_ext = StringInput("deltaOut.txt")
# note: E.g. "C:\Users\localusers\Revit\myJSON.txt"
filepath = String.Concat(string0=directory, string1=filename_inc_ext)

fromJsonFile = JsonData.Utilities.Read.FromJsonFile(filepath=filepath)
keys = JsonData.Elements.JsonObject.Keys(jsonObject=fromJsonFile)
firstItem = List.FirstItem(list=keys)
toNumber = String.ToNumber(str=firstItem)
code_block = CodeBlock(id=toNumber) { Revit.Elements.ElementSelector.ByElementId(id); }
watch = Watch(fromJsonFile)
